# Grasshopper definition visual_debugger.gh (Grasshopper 1.0.8)

script = Script(
    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,
    ExpireOnDiskEvent=False,
    TreatInputAsPath=False,
    SourceLanguageFamilySpec_Taxon="*.*.*",
    SourceLanguageFamilySpec_Version="*.*")
panel = Panel(script)
python_3_script = Python3Script(script=script, shapefile_path="..\DATA\AL_D194_11680_20250123.shp")  # -> out, block_regions, blocks, layout_scores; unedited script template
py3 = Python3Script(layout_scores=python_3_script.layout_scores)  # -> out, a; inputs layout_scores: list
# ---------- py3: Python ----------
for scores in layout_scores:
    print (scores)
# ---------- end py3 ----------
blocks = Geometry(python_3_script.block_regions)
panel_2 = Panel(py3.out)
panel_3 = Panel(python_3_script.out)
